# Dynamo graph RELATORIO DE CLASH EM HTML - R02_script.dyn (Dynamo 2.13.1.3887)
# author: HUDSON CESAR
# IMPORTAR RELATÓRIO DE CLASH (HTML)
# packages: Data-Shapes 2024.2.114

string = StringInput("ROTINA PARA IMPORTAR RELATORIO DE CLASH.")
file_path = Filename("\\servidor\PUBLICO\USUARIOS\HUDSON\LOGO.jpg")
file_from_path = FileObject(path=file_path)
readFromFile = Image.ReadFromFile(file=file_from_path)
string_2 = StringInput("Confirmar")
file_path_2 = Filename("Nenhum arquivo selecionado.")

# group: SELEÇÃO DO ARQUIVO HTML
string_3 = StringInput("Selecione o Relatório de Clash  (*.html)")
filepath_data = Custom[FilePath Data](DefaulPath=file_path_2, ButtonText=string_3)  # package Data-Shapes; Create filepath input for UI.MultipleInputForm ++ . Check out www.data-shapes.net for more infos !
list_create = List.Create(item0=filepath_data)

boolean = BoolSelector(true)
string_4 = StringInput("Cancelar")
number = DoubleInput(200)
multipleinputform = Custom[MultipleInputForm ++](Description_optional=string, Logo_optional=readFromFile, ButtonText_optional=string_2, Inputs=list_create, Toggle=boolean, CancelButtonText_optional=string_4, LabelWidth_optional=number)  # package Data-Shapes; Create a form with multiple inputs. see www.data-shapes.net for tutorials and infos!
code_block = CodeBlock(IN=multipleinputform.User_Inputs) { texto = IN[0]; }

# group: IMPORTAR EXCEL
file_from_path_2 = FileObject(path=code_block)
worksheets = Custom[Excel.Worksheets](FilePath=code_block)  # package Data-Shapes; Gets worksheet names from specified Excel workbook.
boolean_2 = BoolSelector(false)
importExcel = Data.ImportExcel(file=file_from_path_2, sheetName=worksheets, showExcel=boolean_2)
flatten = List.Flatten(list=importExcel)

# group: REDUZIR LISTA
string_from_object = FromObject(object=flatten)
string_5 = StringInput("Image")
contains = String.Contains(string=string_from_object, searchFor=string_5)
filterByBoolMask = List.FilterByBoolMask(list=string_from_object, mask=contains)
indexOf = List.IndexOf(list=flatten, element=filterByBoolMask.in)
code_block_2 = CodeBlock { 1; }
sub = indexOf - code_block_2
code_block_3 = CodeBlock(n=sub) { n; 0..n; }
string_6 = StringInput("Comments")
code_block_4 = CodeBlock { 1; }

# group (continued): IMPORTAR EXCEL
removeItemAtIndex = List.RemoveItemAtIndex(list=flatten, indices=code_block_3.out1)
flatten_2 = List.Flatten(list=removeItemAtIndex)

# group (continued): REDUZIR LISTA
string_from_object_2 = FromObject(object=removeItemAtIndex)
contains_2 = String.Contains(string=string_from_object_2, searchFor=string_6)
filterByBoolMask_2 = List.FilterByBoolMask(list=string_from_object_2, mask=contains_2)
indexOf_2 = List.IndexOf(list=removeItemAtIndex, element=filterByBoolMask_2.in, lacing=Longest)
add = indexOf_2 + code_block_4
count = List.Count(list=removeItemAtIndex, lacing=Longest)
code_block_5 = CodeBlock(n=add, m=count) { n; m; n..m; }

# group (continued): IMPORTAR EXCEL
removeItemAtIndex_2 = List.RemoveItemAtIndex(list=flatten_2, indices=code_block_5.out2)

# group: ELEMENT ID
list_create_2 = List.Create(item0=importExcel)
flatten_3 = List.Flatten(list=removeItemAtIndex_2)
string_from_object_3 = FromObject(object=flatten_3)
string_7 = StringInput("Element Id")
contains_3 = String.Contains(string=string_from_object_3, searchFor=string_7)
filterByBoolMask_3 = List.FilterByBoolMask(list=flatten_3, mask=contains_3)
indexOf_3 = List.IndexOf(list=flatten_3, element=filterByBoolMask_3.in)
firstItem = List.FirstItem(list=indexOf_3)
getItemAtIndex = List.GetItemAtIndex(list=list_create_2@L2, index=firstItem)
code_block_6 = CodeBlock { 0..7; }
removeItemAtIndex_3 = List.RemoveItemAtIndex(list=getItemAtIndex, indices=code_block_6)
string_from_object_4 = FromObject(object=removeItemAtIndex_3)
code_block_7 = CodeBlock { 7; }
code_block_8 = CodeBlock { 7; }
remove = String.Remove(string=string_from_object_4, startIndex=code_block_7, count=code_block_8)
toNumber = String.ToNumber(string=remove)
element_by_id = ElementById(Id=toNumber)
getItemAtIndex_2 = List.GetItemAtIndex(list=flatten_3, index=firstItem)

boolean_3 = BoolSelector(false)
clean = List.Clean(list=element_by_id, preserveIndices=boolean_3)
indexOf_4 = List.IndexOf(list=clean, element=element_by_id)
code_block_9 = CodeBlock { -1; }
eq = indexOf_4 == code_block_9
filterByBoolMask_4 = List.FilterByBoolMask(list=element_by_id, mask=eq)

# group: CLASH NAME
flatten_4 = List.Flatten(list=removeItemAtIndex_2)
string_from_object_5 = FromObject(object=flatten_4)
string_8 = StringInput("Clash Name")
contains_4 = String.Contains(string=string_from_object_5, searchFor=string_8)
filterByBoolMask_5 = List.FilterByBoolMask(list=flatten_4, mask=contains_4)
indexOf_5 = List.IndexOf(list=flatten_4, element=filterByBoolMask_5.in)
getItemAtIndex_3 = List.GetItemAtIndex(list=flatten_4, index=indexOf_5)
list_create_3 = List.Create(item0=importExcel)
getItemAtIndex_4 = List.GetItemAtIndex(list=list_create_3@L2, index=indexOf_5)
code_block_10 = CodeBlock { 0..7; }
removeItemAtIndex_4 = List.RemoveItemAtIndex(list=getItemAtIndex_4, indices=code_block_10)

filterByBoolMask_6 = List.FilterByBoolMask(list=removeItemAtIndex_4, mask=eq)

# group: PREENCHE PARAMETRO CLASH NAME
setParameterByName = Element.SetParameterByName(element=filterByBoolMask_4.out, parameterName=[getItemAtIndex_3, getItemAtIndex_3], value=filterByBoolMask_6.out, lacing=Longest)

# group: STATUS
flatten_5 = List.Flatten(list=removeItemAtIndex_2)
string_from_object_6 = FromObject(object=flatten_5)
string_9 = StringInput("Status")
contains_5 = String.Contains(string=string_from_object_6, searchFor=string_9)
filterByBoolMask_7 = List.FilterByBoolMask(list=flatten_5, mask=contains_5)
indexOf_6 = List.IndexOf(list=flatten_5, element=filterByBoolMask_7.in)
getItemAtIndex_5 = List.GetItemAtIndex(list=flatten_5, index=indexOf_6)
list_create_4 = List.Create(item0=importExcel)
getItemAtIndex_6 = List.GetItemAtIndex(list=list_create_4@L2, index=indexOf_6)
code_block_11 = CodeBlock { 0..7; }
removeItemAtIndex_5 = List.RemoveItemAtIndex(list=getItemAtIndex_6, indices=code_block_11)
string_10 = StringInput("Active")

filterByBoolMask_8 = List.FilterByBoolMask(list=removeItemAtIndex_5, mask=eq)

# group: PREENCHE PARAMETRO STATUS
setParameterByName_2 = Element.SetParameterByName(element=filterByBoolMask_4.out, parameterName=getItemAtIndex_5, value=filterByBoolMask_8.out, lacing=Longest)

string_11 = StringInput("Item ID")
filterByBoolMask_9 = List.FilterByBoolMask(list=toNumber, mask=eq)
string_from_object_7 = FromObject(object=filterByBoolMask_9.out)

# group: PREENCHE PARAMETRO ELEMENT ID
setParameterByName_3 = Element.SetParameterByName(element=filterByBoolMask_4.out, parameterName=string_11, value=string_from_object_7, lacing=Longest)

string_12 = StringInput("Disciplina")
string_from_object_8 = FromObject(object=code_block)
string_13 = StringInput("\")
split = String.Split(string=string_from_object_8, separator0=string_13)
lastItem = List.LastItem(list=split)
setParameterByName_4 = Element.SetParameterByName(element=filterByBoolMask_4.out, parameterName=string_12, value=lastItem, lacing=Longest)

# group (continued): STATUS
ne = filterByBoolMask_8.out != string_10

# group: PREENCHE PARAMETRO RESOLVIDO
string_14 = StringInput("Resolvido")
setParameterByName_5 = Element.SetParameterByName(element=filterByBoolMask_4.out, parameterName=string_14, value=ne, lacing=Longest)

length = String.Length(string=worksheets)
