# Dynamo graph CONEXAO BACIA_script.dyn "SELECIONAR ELEMENTOS VINCULO BACIA" (Dynamo 2.13.1.3887)
# packages: bimorphNodes 5.1.3, Clockwork for Dynamo 2.x 2.4.0, DynaMEP 2.0.1

n1_selecione_o_vinculo = DSModelElementSelection()  # "1. SELECIONE O VINCULO"; 1 picked in the model; graph input

# group: familia para inserir no eixo Z
family_types = FamilyTypes("PVC Esgoto_Adaptador para Saida de Vaso Sanitario:Bacia Sanitária BS (6 UHC)")

python_script = Python()  # IronPython2; unwired: IN[0]
# ---------- python_script.python (65 lines) ----------
# Importando as bibliotecas do Revit e Windows Forms
import clr
clr.AddReference("RevitServices")
from RevitServices.Persistence import DocumentManager
from RevitServices.Transactions import TransactionManager

clr.AddReference("RevitAPI")
from Autodesk.Revit.DB import *

# Adicionando referência para System.Windows.Forms
clr.AddReference("System.Windows.Forms")
from System.Windows.Forms import MessageBox, MessageBoxButtons

# Obtendo o documento atual do Revit
doc = DocumentManager.Instance.CurrentDBDocument

# Função para obter a unidade de comprimento
def get_length_unit_format(doc):
    # Obtendo as unidades do documento
    units = doc.GetUnits()

    # Acessando as opções de formato para o comprimento
    format_options = units.GetFormatOptions(SpecTypeId.Length)

    # Obtendo o ID da unidade de comprimento atual
    unit_type_id = format_options.GetUnitTypeId()

    # Retornando a unidade de comprimento atual
    return unit_type_id

# Função para definir a unidade de comprimento para centímetros
def set_length_unit_to_centimeters(doc):
    # Iniciando uma transação para modificar as unidades
    TransactionManager.Instance.EnsureInTransaction(doc)

    # Obtendo as unidades atuais
    units = doc.GetUnits()

    # Criando novas opções de formato para definir como centímetros
    format_options = FormatOptions(UnitTypeId.Centimeters)

    # Definindo as opções para o comprimento (Length)
    units.SetFormatOptions(SpecTypeId.Length, format_options)

    # Aplicando as mudanças ao documento
    doc.SetUnits(units)

    # Finalizando a transação
    TransactionManager.Instance.TransactionTaskDone()

# Obtendo a unidade de comprimento atual
length_unit = get_length_unit_format(doc)

# Verificando se a unidade não é centímetros e mudando se necessário
if length_unit != UnitTypeId.Centimeters:
    set_length_unit_to_centimeters(doc)
    result = "Unidade de comprimento alterada para Centímetros"
else:
    result = "A unidade de comprimento já está em Centímetros"

# Exibir uma janela pop-up para o usuário confirmar a mensagem
MessageBox.Show(result, "Confirmação", MessageBoxButtons.OK)

# Retornar 1 para o Dynamo após o usuário clicar em OK
OUT = 1
# ----------------------------------------
python_script_2 = Python(IN[0]=python_script)  # IronPython2
# ---------- python_script_2.python (63 lines) ----------
#TEMPLATE Python Script by BIM Coder
#Versão 1.0 - 08/24

#---IMPORTAÇÕES
# Sistema e .NET
import clr
import System
from System import Array
from System.Collections.Generic import *

# Biblioteca de Geometria do Dynamo
clr.AddReference('ProtoGeometry')
from Autodesk.DesignScript.Geometry import *

# Nós do Dynamo
clr.AddReference('RevitNodes')
import Revit
clr.ImportExtensions(Revit.Elements)
clr.ImportExtensions(Revit.GeometryConversion)

# Documentos e Transações
clr.AddReference('RevitServices')
import RevitServices
from RevitServices.Persistence import DocumentManager
from RevitServices.Transactions import TransactionManager

# DB da API do Revit
import Autodesk
clr.AddReference('RevitAPI')
from Autodesk.Revit.DB import *

# Interface do usuário da API do Revit
clr.AddReference('RevitAPIUI')
from Autodesk.Revit.UI import *

from Autodesk.Revit.UI.Selection import ObjectType

# Documentos e Interfaces
doc = DocumentManager.Instance.CurrentDBDocument
uiapp = DocumentManager.Instance.CurrentUIApplication
app = uiapp.Application
uidoc = uiapp.ActiveUIDocument

#---ENTRADA 0: Verificar se a unidade foi alterada para centímetros
unit_check = IN[0]

# Verificando se a entrada 0 é igual a 1 (unidade foi alterada para centímetros)
if unit_check == 1:
    try:
        # Solicitar ao usuário que selecione um objeto do tipo Element (por exemplo, paredes, janelas, etc.)
        selected_reference = uidoc.Selection.PickObject(ObjectType.Element)
        # Obter o elemento a partir da referência
        selected_element = uidoc.Document.GetElement(selected_reference)

        # Saída para o Dynamo (elemento Revit selecionado)
        OUT = selected_element

    except Exception as e:
        # Se houver um erro (como se o usuário cancelar a seleção), retornar uma mensagem de erro
        OUT = str(e)
else:
    # Se a entrada 0 não for 1, exibir uma mensagem dizendo que a unidade não foi alterada
    OUT = "A unidade não foi alterada para centímetros, seleção de elemento não permitida."
# ----------------------------------------
n2_categoria_do_elemento_no = Categories("OST_PlumbingFixtures")  # "2. CATEGORIA DO ELEMENTO NO VINCULO"; graph input
ofCategory = Revit.LinkElement.OfCategory(linkInstance=python_script_2, category=n2_categoria_do_elemento_no)
element = Revit.LinkElement.Element(linkElement=ofCategory)
string_from_object = FromObject(object=element)
n3_nome_do_elemento_no_vinculo = StringInput("BACIA")  # "3. NOME DO ELEMENTO NO VINCULO"; graph input
contains = String.Contains(string=string_from_object, searchFor=n3_nome_do_elemento_no_vinculo)
filterByBoolMask = List.FilterByBoolMask(list=ofCategory, mask=contains)
handOrientation = Custom[FamilyInstance.HandOrientation](familyInstance=filterByBoolMask.in)  # package Clockwork for Dynamo 2.x; Gets the hand orientation of a hosted object (e.g. a window or a door)
getLocation = Element.GetLocation(element=filterByBoolMask.in)
python_script_3 = Python(IN[0]=handOrientation, IN[1]=getLocation)  # IronPython2
# ---------- python_script_3.python (45 lines) ----------
import clr
clr.AddReference('ProtoGeometry')
from Autodesk.DesignScript.Geometry import Point

# Entrada 0: Vetores fornecidos (lista de vetores de orientação)
orientation_vectors = IN[0]

# Entrada 1: Pontos fornecidos (lista de pontos dos elementos - saída do Element.GetLocation)
element_points = IN[1]

# Lista para armazenar os pontos modificados
modified_points = []

# Iterar sobre os vetores e pontos simultaneamente
for i in range(min(len(orientation_vectors), len(element_points))):
    vector = orientation_vectors[i]
    point = element_points[i]
    
    # Modificar o ponto com base nas condições dos vetores
    new_x = point.X
    new_y = point.Y
    new_z = point.Z  # Manter o valor Z inalterado
    
    # Condição para o vetor X = -1
    if vector.X == -1:
        new_y += 30  # Acrescentar 30 ao valor de Y do ponto
    
    # Condição para o vetor X = 1
    if vector.X == 1:
        new_y -= 30  # Subtrair 30 do valor de Y do ponto
    
    # Condição para o vetor Y = -1
    if vector.Y == -1:
        new_x -= 30  # Subtrair 30 do valor de X do ponto
    
    # Condição para o vetor Y = 1
    if vector.Y == 1:
        new_x += 30  # Acrescentar 30 ao valor de X do ponto
    
    # Criar o novo ponto usando o Point.ByCoordinates do Dynamo
    new_point = Point.ByCoordinates(new_x, new_y, new_z)
    modified_points.append(new_point)

# Saída: Lista dos pontos modificados no formato Point.ByCoordinates do Dynamo
OUT = modified_points
# ----------------------------------------
code_block = CodeBlock { "Nível de tabela"; }
getParameterValueByName = Element.GetParameterValueByName(element=filterByBoolMask.in, parameterName=code_block)
name = Level.Name(level=getParameterValueByName)
python_script_4 = Python(IN[0]=name)  # IronPython2
# ---------- python_script_4.python (40 lines) ----------
import clr
clr.AddReference('RevitServices')
from RevitServices.Persistence import DocumentManager
clr.AddReference('RevitAPI')
from Autodesk.Revit.DB import *

# Obter o documento atual do Revit
doc = DocumentManager.Instance.CurrentDBDocument

# Entrada 0: Nomes dos níveis fornecidos (lista de strings)
level_names = IN[0]

# Lista para armazenar os objetos de nível
level_objects = []

# Iterar sobre os nomes de nível fornecidos
for name in level_names:
    # Tentar encontrar o nível pelo nome
    try:
        # Buscar todos os níveis no documento
        collector = FilteredElementCollector(doc).OfClass(Level)
        
        # Verificar se algum nível tem o nome correspondente
        matching_level = None
        for level in collector:
            if level.Name == name:
                matching_level = level
                break
        
        # Adicionar o nível encontrado à lista, ou None se não encontrado
        if matching_level:
            level_objects.append(matching_level)
        else:
            level_objects.append(None)  # Se não houver correspondência, adicionar None
    except:
        # Se houver erro, adicionar None à lista
        level_objects.append(None)

# Saída: Lista de objetos `Level`
OUT = level_objects
# ----------------------------------------
byPointAndLevel = FamilyInstance.ByPointAndLevel(familyType=family_types, point=python_script_3, level=python_script_4)
code_block_2 = CodeBlock { "Elevação do nível"; 0; }
setParameterValueByName = RevitModel.Element.SetParameterValueByName(element=byPointAndLevel, parameterName=code_block_2.out0, values=code_block_2.out1)
