# Dynamo graph NIVEIS_script.dyn (Dynamo 2.13.1.3887)

python_script = Python()  # IronPython2; unwired: IN[0]
# ---------- python_script.python (65 lines) ----------
# Importando as bibliotecas do Revit e Windows Forms
import clr
clr.AddReference("RevitServices")
from RevitServices.Persistence import DocumentManager
from RevitServices.Transactions import TransactionManager

clr.AddReference("RevitAPI")
from Autodesk.Revit.DB import *

# Adicionando referência para System.Windows.Forms
clr.AddReference("System.Windows.Forms")
from System.Windows.Forms import MessageBox, MessageBoxButtons

# Obtendo o documento atual do Revit
doc = DocumentManager.Instance.CurrentDBDocument

# Função para obter a unidade de comprimento
def get_length_unit_format(doc):
    # Obtendo as unidades do documento
    units = doc.GetUnits()

    # Acessando as opções de formato para o comprimento
    format_options = units.GetFormatOptions(SpecTypeId.Length)

    # Obtendo o ID da unidade de comprimento atual
    unit_type_id = format_options.GetUnitTypeId()

    # Retornando a unidade de comprimento atual
    return unit_type_id

# Função para definir a unidade de comprimento para centímetros
def set_length_unit_to_meters(doc):
    # Iniciando uma transação para modificar as unidades
    TransactionManager.Instance.EnsureInTransaction(doc)

    # Obtendo as unidades atuais
    units = doc.GetUnits()

    # Criando novas opções de formato para definir como centímetros
    format_options = FormatOptions(UnitTypeId.Meters)

    # Definindo as opções para o comprimento (Length)
    units.SetFormatOptions(SpecTypeId.Length, format_options)

    # Aplicando as mudanças ao documento
    doc.SetUnits(units)

    # Finalizando a transação
    TransactionManager.Instance.TransactionTaskDone()

# Obtendo a unidade de comprimento atual
length_unit = get_length_unit_format(doc)

# Verificando se a unidade não é centímetros e mudando se necessário
if length_unit != UnitTypeId.Meters:
    set_length_unit_to_meters(doc)
    result = "Unidade de comprimento alterada para Metros"
else:
    result = "A unidade de comprimento já está em Metros"

# Exibir uma janela pop-up para o usuário confirmar a mensagem
MessageBox.Show(result, "Confirmação", MessageBoxButtons.OK)

# Retornar 1 para o Dynamo após o usuário clicar em OK
OUT = 1
# ----------------------------------------
python_script_2 = Python(IN[0]=python_script)  # IronPython2
# ---------- python_script_2.python (63 lines) ----------
#TEMPLATE Python Script by BIM Coder
#Versão 1.0 - 08/24

#---IMPORTAÇÕES
# Sistema e .NET
import clr
import System
from System import Array
from System.Collections.Generic import *

# Biblioteca de Geometria do Dynamo
clr.AddReference('ProtoGeometry')
from Autodesk.DesignScript.Geometry import *

# Nós do Dynamo
clr.AddReference('RevitNodes')
import Revit
clr.ImportExtensions(Revit.Elements)
clr.ImportExtensions(Revit.GeometryConversion)

# Documentos e Transações
clr.AddReference('RevitServices')
import RevitServices
from RevitServices.Persistence import DocumentManager
from RevitServices.Transactions import TransactionManager

# DB da API do Revit
import Autodesk
clr.AddReference('RevitAPI')
from Autodesk.Revit.DB import *

# Interface do usuário da API do Revit
clr.AddReference('RevitAPIUI')
from Autodesk.Revit.UI import *

from Autodesk.Revit.UI.Selection import ObjectType

# Documentos e Interfaces
doc = DocumentManager.Instance.CurrentDBDocument
uiapp = DocumentManager.Instance.CurrentUIApplication
app = uiapp.Application
uidoc = uiapp.ActiveUIDocument

#---ENTRADA 0: Verificar se a unidade foi alterada para centímetros
unit_check = IN[0]

# Verificando se a entrada 0 é igual a 1 (unidade foi alterada para centímetros)
if unit_check == 1:
    try:
        # Solicitar ao usuário que selecione um objeto do tipo Element (por exemplo, paredes, janelas, etc.)
        selected_reference = uidoc.Selection.PickObject(ObjectType.Element)
        # Obter o elemento a partir da referência
        selected_element = uidoc.Document.GetElement(selected_reference)

        # Saída para o Dynamo (elemento Revit selecionado)
        OUT = selected_element

    except Exception as e:
        # Se houver um erro (como se o usuário cancelar a seleção), retornar uma mensagem de erro
        OUT = str(e)
else:
    # Se a entrada 0 não for 1, exibir uma mensagem dizendo que a unidade não foi alterada
    OUT = "A unidade não foi alterada para centímetros, seleção de elemento não permitida."
# ----------------------------------------
python_script_3 = Python(IN[0]=python_script_2)  # IronPython2
# ---------- python_script_3.python (41 lines) ----------
import clr
clr.AddReference('RevitServices')
clr.AddReference('RevitAPI')
clr.AddReference('RevitNodes')

from RevitServices.Persistence import DocumentManager
from Autodesk.Revit.DB import *

# Obter o documento ativo
doc = DocumentManager.Instance.CurrentDBDocument

# Entrada 0: Elemento do vínculo selecionado pelo usuário
vinculo_selecionado = UnwrapElement(IN[0])  # Desempacota o elemento Revit do Dynamo

# Verificar se o vínculo selecionado é válido
if vinculo_selecionado and isinstance(vinculo_selecionado, RevitLinkInstance):
    # Obter o documento vinculado (arquivo RVT vinculado)
    link_doc = vinculo_selecionado.GetLinkDocument()

    # Verificar se o documento vinculado existe
    if link_doc is None:
        OUT = "Erro: Documento vinculado não encontrado."
    else:
        # Coletar os níveis do vínculo
        niveis_vinculados = FilteredElementCollector(link_doc).OfCategory(BuiltInCategory.OST_Levels).WhereElementIsNotElementType().ToElements()

        # Criar duas listas, uma para os nomes e outra para as elevações usando o parâmetro 'Elevation'
        nomes_niveis = [nivel.Name for nivel in niveis_vinculados]
        elevacoes_niveis = []
        
        for nivel in niveis_vinculados:
            # Acessar o parâmetro "Elevação" do nível
            elevacao_param = nivel.get_Parameter(BuiltInParameter.LEVEL_ELEV).AsDouble()
            # Converter a elevação para metros (unidade padrão do Revit é pés)
            elevacao_metros = UnitUtils.ConvertFromInternalUnits(elevacao_param, UnitTypeId.Meters)
            elevacoes_niveis.append(elevacao_metros)

        # Saída: Duas listas - uma com os nomes dos níveis e outra com as elevações
        OUT = (nomes_niveis, elevacoes_niveis)
else:
    OUT = "Erro: Por favor, selecione um vínculo válido na entrada 0."
# ----------------------------------------
code_block = CodeBlock { 0; 1; }
getItemAtIndex = List.GetItemAtIndex(list=python_script_3, index=code_block.out1)
getItemAtIndex_2 = List.GetItemAtIndex(list=python_script_3, index=code_block.out0)
byElevationAndName = Level.ByElevationAndName(elevation=getItemAtIndex, name=getItemAtIndex_2)
byLevel = FloorPlanView.ByLevel(level=byElevationAndName)
