# Dynamo graph LOCALIZAÇÃOH_script.dyn (Dynamo 2.13.1.3887)

seleção_dos_elementos = Python()  # IronPython2; frozen; unwired: IN[0]
# ---------- seleção_dos_elementos.python (57 lines) ----------
#TEMPLATE Python Script by BIM Coder
#Versão 1.0 - 08/24

#---IMPORTAÇÕES
# Sistema e .NET
import clr
import sys
import System
from System import Array
from System.Collections.Generic import *

# Biblioteca de Geometria do Dynamo
clr.AddReference('ProtoGeometry')
from Autodesk.DesignScript.Geometry import *

# Nós do Dynamo
clr.AddReference('RevitNodes')
import Revit
clr.ImportExtensions(Revit.Elements)
clr.ImportExtensions(Revit.GeometryConversion)

# Documentos e Transações
clr.AddReference('RevitServices')
import RevitServices
from RevitServices.Persistence import DocumentManager
from RevitServices.Transactions import TransactionManager

# DB da API do Revit
import Autodesk
clr.AddReference('RevitAPI')
from Autodesk.Revit.DB import *

# Interface do usuário da API do Revit
clr.AddReference('RevitAPIUI')
from Autodesk.Revit.UI import *

from Autodesk.Revit.UI.Selection import ObjectType

# Documentos e Interfaces
doc = DocumentManager.Instance.CurrentDBDocument
uiapp = DocumentManager.Instance.CurrentUIApplication
app = uiapp.Application
uidoc = uiapp.ActiveUIDocument

#---CLASSES E FUNÇÕES

#---SCRIPT

# Solicitar ao usuário que selecione múltiplos objetos do tipo Element (por exemplo, paredes, janelas, etc.)

selected_references = uidoc.Selection.PickObjects(ObjectType.Element)

# Obter os elementos a partir das referências
selected_elements = [uidoc.Document.GetElement(reference) for reference in selected_references]

# Saída para o Dynamo (lista de elementos Revit)
OUT = selected_elements
# ----------------------------------------
getChildElements = Element.GetChildElements(element=seleção_dos_elementos, lacing=Longest)
flatten = List.Flatten(list=getChildElements)
isNull = Object.IsNull(object=flatten)
filterByBoolMask = List.FilterByBoolMask(list=seleção_dos_elementos, mask=isNull)
list_create = List.Create(item0=getChildElements, item1=filterByBoolMask.in)
flatten_2 = List.Flatten(list=list_create)
isNull_2 = Object.IsNull(object=flatten_2)
filterByBoolMask_2 = List.FilterByBoolMask(list=flatten_2, mask=isNull_2)
TEXTO = Python()  # IronPython2; frozen; unwired: IN[0]
# ---------- TEXTO.python (62 lines) ----------
import clr
clr.AddReference('System.Windows.Forms')
clr.AddReference('System.Drawing')

from System.Windows.Forms import Application, Form, Label, TextBox, Button, FormStartPosition
from System.Drawing import Point, Size, Color

class MyForm(Form):
    def __init__(self, theme='Dark'):
        # Configurações do Formulário
        self.Text = "Parâmetro ORÇAMENTO LOCALIZAÇÃO"
        self.Size = Size(350, 200)
        self.StartPosition = FormStartPosition.CenterScreen
        self.ShowIcon = False
        self.MaximizeBox = False
        self.MinimizeBox = False

        # Configuração do tema
        if theme == 'Light':
            self.BackColor = Color.White
            self.ForeColor = Color.Black
        else:
            self.BackColor = Color.FromArgb(45, 45, 48)  # Dark theme
            self.ForeColor = Color.White

        self.create_form()
        self.create_ok_button()

    def create_form(self):
        """Cria a Label e o campo de entrada de texto."""
        lbl = Label()
        lbl.Text = "Digite o texto:"
        lbl.Location = Point(20, 20)
        lbl.Size = Size(150, 30)
        self.Controls.Add(lbl)

        self.txt_input = TextBox()
        self.txt_input.Location = Point(20, 50)
        self.txt_input.Size = Size(240, 30)
        self.Controls.Add(self.txt_input)

    def create_ok_button(self):
        """Cria o botão OK para capturar o texto e fechar o formulário."""
        btn_ok = Button()
        btn_ok.Text = "OK"
        btn_ok.Location = Point((self.ClientSize.Width - 100) // 2, 90)
        btn_ok.Size = Size(100, 30)
        btn_ok.Click += self.on_ok
        self.Controls.Add(btn_ok)

    def on_ok(self, sender, event):
        """Captura o texto digitado e fecha o formulário."""
        self.user_input = self.txt_input.Text
        self.Close()

# Criação do formulário
theme = "Dark"  # Você pode mudar para "Light" se quiser o tema claro
form = MyForm(theme)
Application.Run(form)

# O texto inserido pelo usuário será armazenado na variável 'form.user_input'
OUT = form.user_input
# ----------------------------------------
preencher_o_parametro = Python(IN[0]=filterByBoolMask_2.out, IN[1]=TEXTO)  # IronPython2
# ---------- preencher_o_parametro.python (30 lines) ----------
import clr
clr.AddReference('RevitServices')
clr.AddReference('RevitAPI')
clr.AddReference('RevitAPIUI')

from RevitServices.Persistence import DocumentManager
from RevitServices.Transactions import TransactionManager
from Autodesk.Revit.DB import Element

# Obter o documento ativo do Revit
doc = DocumentManager.Instance.CurrentDBDocument

# Obter os elementos selecionados a partir de IN[0] e o texto da IN[1]
elements = UnwrapElement(IN[0])  # Desembrulha os elementos do Dynamo
text_to_set = IN[1]  # Texto a ser inserido no parâmetro "ORÇAMENTO LOCALIZAÇÃO"

# Iniciar uma transação para modificar os parâmetros no Revit
TransactionManager.Instance.EnsureInTransaction(doc)

# Iterar sobre os elementos e definir o valor no parâmetro "ORÇAMENTO LOCALIZAÇÃO"
for element in elements:
    marca_param = element.LookupParameter("ORÇAMENTO LOCALIZAÇÃO")
    if marca_param and not marca_param.IsReadOnly:
        marca_param.Set(text_to_set)

# Finalizar a transação
TransactionManager.Instance.TransactionTaskDone()

# Saída
OUT = "Texto atualizado no parâmetro 'ORÇAMENTO LOCALIZAÇÃO' para {} elementos.".format(len(elements))
# ----------------------------------------
id = Element.Id(element=filterByBoolMask_2.out, lacing=Longest)
code_block = CodeBlock { 8513803; }  # frozen
eq = id == code_block
filterByBoolMask_3 = List.FilterByBoolMask(list=id, mask=eq)
python_script = Python()  # IronPython2; frozen; unwired: IN[0]; same code as seleção_dos_elementos
TEXTO_2 = Python()  # IronPython2; frozen; unwired: IN[0]
# ---------- TEXTO_2.python (112 lines) ----------
import clr
clr.AddReference('System.Windows.Forms')
clr.AddReference('System.Drawing')

from System.Windows.Forms import Application, Form, Label, TextBox, Button, FormStartPosition
from System.Drawing import Point, Size, Color

class MyForm(Form):
    def __init__(self, theme='Dark'):
        # Configurações do Formulário
        self.Text = "Parâmetro ORÇAMENTO TIPO DE SISTEMA"
        self.Size = Size(350, 400)
        self.StartPosition = FormStartPosition.CenterScreen
        self.ShowIcon = False
        self.MaximizeBox = False
        self.MinimizeBox = False

        # Configuração do tema
        if theme == 'Light':
            self.BackColor = Color.White
            self.ForeColor = Color.Black
        else:
            self.BackColor = Color.FromArgb(45, 45, 48)  # Dark theme
            self.ForeColor = Color.White

        self.error_label = None  # Inicializando a variável para o erro
        self.create_form()
        self.create_ok_button()

    def create_form(self):
        """Cria a Label com as opções e o campo de entrada de texto."""
        lbl_options = Label()
        lbl_options.Text = (
            "\nEscolha uma opção:\n\n"
            "1 - AUTOMACAO\n2 - CABEAMENTO ESTRUTURADO\n3 - CFTV\n4 - COMUNICACAO VISUAL\n"
            "5 - DRENAGEM PLUVIAL\n6 - ELETRICO\n7 - EST. CONCRETO\n8 - EST. METALICA\n"
            "9 - GASES MEDICINAIS\n10 - GLP\n11 - HIDROSSANITARIO\n12 - INCENDIO\n"
            "13 - LUMINOTECNICO\n14 - SDAI\n15 - SPDA"
        )
        lbl_options.Location = Point(20, 20)
        lbl_options.Size = Size(300, 220)
        lbl_options.AutoSize = True
        self.Controls.Add(lbl_options)

        self.txt_input = TextBox()
        self.txt_input.Location = Point(20, 250)
        self.txt_input.Size = Size(240, 30)
        self.Controls.Add(self.txt_input)

    def create_ok_button(self):
        """Cria o botão OK para capturar o texto e fechar o formulário."""
        btn_ok = Button()
        btn_ok.Text = "OK"
        btn_ok.Location = Point((self.ClientSize.Width - 100) // 2, 300)
        btn_ok.Size = Size(100, 30)
        btn_ok.Click += self.on_ok
        self.Controls.Add(btn_ok)

    def on_ok(self, sender, event):
        """Captura o texto digitado e fecha o formulário."""
        options = {
            1: "AUTOMACAO",
            2: "CABEAMENTO ESTRUTURADO",
            3: "CFTV",
            4: "COMUNICACAO VISUAL",
            5: "DRENAGEM PLUVIAL",
            6: "ELETRICO",
            7: "EST. CONCRETO",
            8: "EST. METALICA",
            9: "GASES MEDICINAIS",
            10: "GLP",
            11: "HIDROSSANITARIO",
            12: "INCENDIO",
            13: "LUMINOTECNICO",
            14: "SDAI",
            15: "SPDA"
        }

        try:
            # Remove a mensagem de erro anterior, se existir
            if self.error_label:
                self.Controls.Remove(self.error_label)

            input_value = int(self.txt_input.Text)
            if input_value in options:
                self.user_input = options[input_value]
            else:
                self.user_input = None
                self.show_error("Por favor, escolha uma opção válida (1-15).")
        except ValueError:
            self.user_input = None
            self.show_error("Por favor, insira um número válido.")

        if self.user_input is not None:
            self.Close()

    def show_error(self, message):
        """Exibe uma mensagem de erro."""
        self.error_label = Label()
        self.error_label.Text = message
        self.error_label.Location = Point(20, 340)
        self.error_label.Size = Size(300, 30)
        self.error_label.ForeColor = Color.Red
        self.Controls.Add(self.error_label)

# Criação do formulário
theme = "Dark"  # Você pode mudar para "Light" se quiser o tema claro
form = MyForm(theme)
Application.Run(form)

# O texto correspondente à opção escolhida será armazenado na variável 'form.user_input'
OUT = form.user_input
# ----------------------------------------
python_script_2 = Python()  # IronPython2; unwired: IN[0]; same code as seleção_dos_elementos
python_script_3 = Python(IN[0]=python_script_2)  # IronPython2
# ---------- python_script_3.python (46 lines) ----------
import clr
clr.AddReference('RevitServices')
from RevitServices.Persistence import DocumentManager

clr.AddReference("RevitAPI")
from Autodesk.Revit.DB import *

# Função para listar os elementos principais e suas famílias aninhadas
def get_all_elements(element):
    element_list = []
    
    # Verificar se o elemento é uma instância de uma família
    if isinstance(element, FamilyInstance):
        # Adicionar o elemento principal à lista
        element_list.append(element)
        
        # Tentar obter os subcomponentes do elemento
        sub_elements = element.GetSubComponentIds()
        if sub_elements.Count > 0:
            # Adicionar subcomponentes (famílias aninhadas)
            for sub_elem_id in sub_elements:
                sub_elem = doc.GetElement(sub_elem_id)
                if isinstance(sub_elem, FamilyInstance):
                    element_list.append(sub_elem)
        else:
            print(f"O elemento {element.Id} não possui subcomponentes.")
    else:
        print(f"O elemento {element.Id} não é uma instância de uma família.")

    return element_list

# Coletando o documento ativo
doc = DocumentManager.Instance.CurrentDBDocument

# Entrada 0 - elementos selecionados
input_elements = UnwrapElement(IN[0])

# Inicializando a lista de todos os elementos (principais e aninhados)
all_elements = []

# Verificando todos os elementos e suas famílias aninhadas
for element in input_elements:
    all_elements.extend(get_all_elements(element))

# Saída - lista de todos os elementos, incluindo principais e aninhados
OUT = all_elements
# ----------------------------------------
TEXTO_3 = Python()  # IronPython2; unwired: IN[0]; same code as TEXTO
preencher_o_parametro_2 = Python(IN[0]=python_script_3, IN[1]=TEXTO_3)  # IronPython2
# ---------- preencher_o_parametro_2.python (30 lines) ----------
import clr
clr.AddReference('RevitServices')
clr.AddReference('RevitAPI')
clr.AddReference('RevitAPIUI')

from RevitServices.Persistence import DocumentManager
from RevitServices.Transactions import TransactionManager
from Autodesk.Revit.DB import Element

# Obter o documento ativo do Revit
doc = DocumentManager.Instance.CurrentDBDocument

# Obter os elementos selecionados a partir de IN[0] e o texto da IN[1]
elements = UnwrapElement(IN[0])  # Desembrulha os elementos do Dynamo
text_to_set = IN[1]  # Texto a ser inserido no parâmetro "ORÇAMENTO TIPO DE SISTEMA"

# Iniciar uma transação para modificar os parâmetros no Revit
TransactionManager.Instance.EnsureInTransaction(doc)

# Iterar sobre os elementos e definir o valor no parâmetro "ORÇAMENTO TIPO DE SISTEMA"
for element in elements:
    marca_param = element.LookupParameter("ORÇAMENTO LOCALIZAÇÃO")
    if marca_param and not marca_param.IsReadOnly:
        marca_param.Set(text_to_set)

# Finalizar a transação
TransactionManager.Instance.TransactionTaskDone()

# Saída
OUT = "Texto atualizado no parâmetro 'ORÇAMENTO LOCALIZAÇÃO' para {} elementos.".format(len(elements))
# ----------------------------------------
python_script_4 = Python()  # IronPython2; frozen; unwired: IN[0]
# ---------- python_script_4.python (62 lines) ----------
# TEMPLATE Python Script by BIM Coder
# Versão 1.0 - 08/24

#---IMPORTAÇÕES
# Sistema e .NET
import clr
import sys
import System
from System.Collections.Generic import *

# Biblioteca de Geometria do Dynamo
clr.AddReference('ProtoGeometry')
from Autodesk.DesignScript.Geometry import *

# Nós do Dynamo
clr.AddReference('RevitNodes')
import Revit
clr.ImportExtensions(Revit.Elements)
clr.ImportExtensions(Revit.GeometryConversion)

# Documentos e Transações
clr.AddReference('RevitServices')
import RevitServices
from RevitServices.Persistence import DocumentManager
from RevitServices.Transactions import TransactionManager

# DB da API do Revit
import Autodesk
clr.AddReference('RevitAPI')
from Autodesk.Revit.DB import *

# Interface do usuário da API do Revit
clr.AddReference('RevitAPIUI')
from Autodesk.Revit.UI import *

from Autodesk.Revit.UI.Selection import ObjectType

# Documentos e Interfaces
doc = DocumentManager.Instance.CurrentDBDocument
uiapp = DocumentManager.Instance.CurrentUIApplication
app = uiapp.Application
uidoc = uiapp.ActiveUIDocument

#---SCRIPT
try:
    # Solicitar ao usuário que selecione múltiplos objetos do tipo Element (por exemplo, paredes, janelas, etc.)
    selected_references = uidoc.Selection.PickObjects(ObjectType.Element)
    
    # Verificar se o usuário realmente selecionou algo
    if selected_references is not None:
        # Obter os elementos a partir das referências
        selected_elements = [uidoc.Document.GetElement(reference) for reference in selected_references]

        # Saída para o Dynamo (lista de elementos Revit)
        OUT = selected_elements
    else:
        # Caso o usuário não selecione nada, definir saída apropriada
        OUT = "Nenhum elemento foi selecionado."
        
except Exception as e:
    # Captura o erro e exibe a mensagem de erro para o Dynamo
    OUT = "Erro: " + str(e)
# ----------------------------------------
python_script_5 = Python()  # IronPython2; frozen; unwired: IN[0]
# ---------- python_script_5.python (37 lines) ----------
import clr
clr.AddReference('RevitServices')
from RevitServices.Persistence import DocumentManager

clr.AddReference("RevitAPI")
from Autodesk.Revit.DB import *

# Função para listar os elementos principais e suas famílias aninhadas
def get_all_elements(element):
    element_list = []
    if isinstance(element, FamilyInstance):
        # Adicionar o elemento principal à lista
        element_list.append(element)
        
        # Verificar e adicionar famílias aninhadas
        sub_elements = element.GetSubComponentIds()
        for sub_elem_id in sub_elements:
            sub_elem = doc.GetElement(sub_elem_id)
            if isinstance(sub_elem, FamilyInstance):
                element_list.append(sub_elem)
    return element_list

# Coletando o documento ativo
doc = DocumentManager.Instance.CurrentDBDocument

# Entrada 0 - elementos selecionados
input_elements = UnwrapElement(IN[0])

# Inicializando a lista de todos os elementos (principais e aninhados)
all_elements = []

# Verificando todos os elementos e suas famílias aninhadas
for element in input_elements:
    all_elements.extend(get_all_elements(element))

# Saída - lista de todos os elementos, incluindo principais e aninhados
OUT = all_elements
# ----------------------------------------
