# Dynamo graph TIPO DE SISTEMAH_script.dyn (Dynamo 2.13.1.3887)

TEXTO = Python()  # IronPython2; frozen; unwired: IN[0]
# ---------- TEXTO.python (62 lines) ----------
import clr
clr.AddReference('System.Windows.Forms')
clr.AddReference('System.Drawing')

from System.Windows.Forms import Application, Form, Label, TextBox, Button, FormStartPosition
from System.Drawing import Point, Size, Color

class MyForm(Form):
    def __init__(self, theme='Dark'):
        # Configurações do Formulário
        self.Text = "Parâmetro ORÇAMENTO TIPO DE SISTEMA"
        self.Size = Size(350, 200)
        self.StartPosition = FormStartPosition.CenterScreen
        self.ShowIcon = False
        self.MaximizeBox = False
        self.MinimizeBox = False

        # Configuração do tema
        if theme == 'Light':
            self.BackColor = Color.White
            self.ForeColor = Color.Black
        else:
            self.BackColor = Color.FromArgb(45, 45, 48)  # Dark theme
            self.ForeColor = Color.White

        self.create_form()
        self.create_ok_button()

    def create_form(self):
        """Cria a Label e o campo de entrada de texto."""
        lbl = Label()
        lbl.Text = "Digite o texto:"
        lbl.Location = Point(20, 20)
        lbl.Size = Size(150, 30)
        self.Controls.Add(lbl)

        self.txt_input = TextBox()
        self.txt_input.Location = Point(20, 50)
        self.txt_input.Size = Size(240, 30)
        self.Controls.Add(self.txt_input)

    def create_ok_button(self):
        """Cria o botão OK para capturar o texto e fechar o formulário."""
        btn_ok = Button()
        btn_ok.Text = "OK"
        btn_ok.Location = Point((self.ClientSize.Width - 100) // 2, 90)
        btn_ok.Size = Size(100, 30)
        btn_ok.Click += self.on_ok
        self.Controls.Add(btn_ok)

    def on_ok(self, sender, event):
        """Captura o texto digitado e fecha o formulário."""
        self.user_input = self.txt_input.Text
        self.Close()

# Criação do formulário
theme = "Dark"  # Você pode mudar para "Light" se quiser o tema claro
form = MyForm(theme)
Application.Run(form)

# O texto inserido pelo usuário será armazenado na variável 'form.user_input'
OUT = form.user_input
# ----------------------------------------
seleção_dos_elementos = Python()  # IronPython2; frozen; unwired: IN[0]
# ---------- seleção_dos_elementos.python (57 lines) ----------
#TEMPLATE Python Script by BIM Coder
#Versão 1.0 - 08/24

#---IMPORTAÇÕES
# Sistema e .NET
import clr
import sys
import System
from System import Array
from System.Collections.Generic import *

# Biblioteca de Geometria do Dynamo
clr.AddReference('ProtoGeometry')
from Autodesk.DesignScript.Geometry import *

# Nós do Dynamo
clr.AddReference('RevitNodes')
import Revit
clr.ImportExtensions(Revit.Elements)
clr.ImportExtensions(Revit.GeometryConversion)

# Documentos e Transações
clr.AddReference('RevitServices')
import RevitServices
from RevitServices.Persistence import DocumentManager
from RevitServices.Transactions import TransactionManager

# DB da API do Revit
import Autodesk
clr.AddReference('RevitAPI')
from Autodesk.Revit.DB import *

# Interface do usuário da API do Revit
clr.AddReference('RevitAPIUI')
from Autodesk.Revit.UI import *

from Autodesk.Revit.UI.Selection import ObjectType

# Documentos e Interfaces
doc = DocumentManager.Instance.CurrentDBDocument
uiapp = DocumentManager.Instance.CurrentUIApplication
app = uiapp.Application
uidoc = uiapp.ActiveUIDocument

#---CLASSES E FUNÇÕES

#---SCRIPT

# Solicitar ao usuário que selecione múltiplos objetos do tipo Element (por exemplo, paredes, janelas, etc.)

selected_references = uidoc.Selection.PickObjects(ObjectType.Element)

# Obter os elementos a partir das referências
selected_elements = [uidoc.Document.GetElement(reference) for reference in selected_references]

# Saída para o Dynamo (lista de elementos Revit)
OUT = selected_elements
# ----------------------------------------
getChildElements = Element.GetChildElements(element=seleção_dos_elementos, lacing=Longest)
flatten = List.Flatten(list=getChildElements)
isNull = Object.IsNull(object=flatten)
filterByBoolMask = List.FilterByBoolMask(list=seleção_dos_elementos, mask=isNull)
list_create = List.Create(item0=getChildElements, item1=filterByBoolMask.in)
flatten_2 = List.Flatten(list=list_create)
isNull_2 = Object.IsNull(object=flatten_2)
filterByBoolMask_2 = List.FilterByBoolMask(list=flatten_2, mask=isNull_2)
TEXTO_2 = Python()  # IronPython2; frozen; unwired: IN[0]
# ---------- TEXTO_2.python (112 lines) ----------
import clr
clr.AddReference('System.Windows.Forms')
clr.AddReference('System.Drawing')

from System.Windows.Forms import Application, Form, Label, TextBox, Button, FormStartPosition
from System.Drawing import Point, Size, Color

class MyForm(Form):
    def __init__(self, theme='Dark'):
        # Configurações do Formulário
        self.Text = "Parâmetro ORÇAMENTO TIPO DE SISTEMA"
        self.Size = Size(350, 400)
        self.StartPosition = FormStartPosition.CenterScreen
        self.ShowIcon = False
        self.MaximizeBox = False
        self.MinimizeBox = False

        # Configuração do tema
        if theme == 'Light':
            self.BackColor = Color.White
            self.ForeColor = Color.Black
        else:
            self.BackColor = Color.FromArgb(45, 45, 48)  # Dark theme
            self.ForeColor = Color.White

        self.error_label = None  # Inicializando a variável para o erro
        self.create_form()
        self.create_ok_button()

    def create_form(self):
        """Cria a Label com as opções e o campo de entrada de texto."""
        lbl_options = Label()
        lbl_options.Text = (
            "\nEscolha uma opção:\n\n"
            "1 - AUTOMACAO\n2 - CABEAMENTO ESTRUTURADO\n3 - CFTV\n4 - COMUNICACAO VISUAL\n"
            "5 - DRENAGEM PLUVIAL\n6 - ELETRICO\n7 - EST. CONCRETO\n8 - EST. METALICA\n"
            "9 - GASES MEDICINAIS\n10 - GLP\n11 - HIDROSSANITARIO\n12 - INCENDIO\n"
            "13 - LUMINOTECNICO\n14 - SDAI\n15 - SPDA"
        )
        lbl_options.Location = Point(20, 20)
        lbl_options.Size = Size(300, 220)
        lbl_options.AutoSize = True
        self.Controls.Add(lbl_options)

        self.txt_input = TextBox()
        self.txt_input.Location = Point(20, 250)
        self.txt_input.Size = Size(240, 30)
        self.Controls.Add(self.txt_input)

    def create_ok_button(self):
        """Cria o botão OK para capturar o texto e fechar o formulário."""
        btn_ok = Button()
        btn_ok.Text = "OK"
        btn_ok.Location = Point((self.ClientSize.Width - 100) // 2, 300)
        btn_ok.Size = Size(100, 30)
        btn_ok.Click += self.on_ok
        self.Controls.Add(btn_ok)

    def on_ok(self, sender, event):
        """Captura o texto digitado e fecha o formulário."""
        options = {
            1: "AUTOMACAO",
            2: "CABEAMENTO ESTRUTURADO",
            3: "CFTV",
            4: "COMUNICACAO VISUAL",
            5: "DRENAGEM PLUVIAL",
            6: "ELETRICO",
            7: "EST. CONCRETO",
            8: "EST. METALICA",
            9: "GASES MEDICINAIS",
            10: "GLP",
            11: "HIDROSSANITARIO",
            12: "INCENDIO",
            13: "LUMINOTECNICO",
            14: "SDAI",
            15: "SPDA"
        }

        try:
            # Remove a mensagem de erro anterior, se existir
            if self.error_label:
                self.Controls.Remove(self.error_label)

            input_value = int(self.txt_input.Text)
            if input_value in options:
                self.user_input = options[input_value]
            else:
                self.user_input = None
                self.show_error("Por favor, escolha uma opção válida (1-15).")
        except ValueError:
            self.user_input = None
            self.show_error("Por favor, insira um número válido.")

        if self.user_input is not None:
            self.Close()

    def show_error(self, message):
        """Exibe uma mensagem de erro."""
        self.error_label = Label()
        self.error_label.Text = message
        self.error_label.Location = Point(20, 340)
        self.error_label.Size = Size(300, 30)
        self.error_label.ForeColor = Color.Red
        self.Controls.Add(self.error_label)

# Criação do formulário
theme = "Dark"  # Você pode mudar para "Light" se quiser o tema claro
form = MyForm(theme)
Application.Run(form)

# O texto correspondente à opção escolhida será armazenado na variável 'form.user_input'
OUT = form.user_input
# ----------------------------------------
preencher_o_parametro = Python(IN[0]=filterByBoolMask_2.out, IN[1]=TEXTO_2)  # IronPython2
# ---------- preencher_o_parametro.python (30 lines) ----------
import clr
clr.AddReference('RevitServices')
clr.AddReference('RevitAPI')
clr.AddReference('RevitAPIUI')

from RevitServices.Persistence import DocumentManager
from RevitServices.Transactions import TransactionManager
from Autodesk.Revit.DB import Element

# Obter o documento ativo do Revit
doc = DocumentManager.Instance.CurrentDBDocument

# Obter os elementos selecionados a partir de IN[0] e o texto da IN[1]
elements = UnwrapElement(IN[0])  # Desembrulha os elementos do Dynamo
text_to_set = IN[1]  # Texto a ser inserido no parâmetro "ORÇAMENTO TIPO DE SISTEMA"

# Iniciar uma transação para modificar os parâmetros no Revit
TransactionManager.Instance.EnsureInTransaction(doc)

# Iterar sobre os elementos e definir o valor no parâmetro "ORÇAMENTO TIPO DE SISTEMA"
for element in elements:
    marca_param = element.LookupParameter("ORÇAMENTO TIPO DE SISTEMA")
    if marca_param and not marca_param.IsReadOnly:
        marca_param.Set(text_to_set)

# Finalizar a transação
TransactionManager.Instance.TransactionTaskDone()

# Saída
OUT = "Texto atualizado no parâmetro 'ORÇAMENTO TIPO DE SISTEMA' para {} elementos.".format(len(elements))
# ----------------------------------------
python_script = Python()  # IronPython2; frozen; unwired: IN[0]
# ---------- python_script.python (34 lines) ----------
# Importando bibliotecas necessárias
import clr
clr.AddReference('RevitAPI')
clr.AddReference('RevitServices')
from RevitServices.Persistence import DocumentManager
from Autodesk.Revit.DB import ElementId, FilteredElementCollector

# Obtendo o documento ativo do Revit
doc = DocumentManager.Instance.CurrentDBDocument

# Função para obter elementos filhos
def get_child_elements(element):
    child_elements = []
    
    # Coletor para buscar elementos
    collector = FilteredElementCollector(doc).WhereElementIsNotElementType()
    
    for el in collector:
        # Verifica se o elemento é filho do elemento pai (ajuste conforme a lógica necessária)
        if el.GetType() == element.GetType() and el.OwnerViewId == element.OwnerViewId:
            child_elements.append(el)
    
    return child_elements

# Processando a entrada (lista de elementos)
input_elements = UnwrapElement(IN[0])  # IN[0] é a entrada da lista de elementos
all_child_elements = []

for elem in input_elements:
    children = get_child_elements(elem)
    all_child_elements.extend(children)  # Adiciona os filhos à lista principal

# Saída: lista única de todos os elementos filhos
OUT = all_child_elements
# ----------------------------------------
python_script_2 = Python()  # IronPython2; frozen; unwired: IN[0]; same code as seleção_dos_elementos
python_script_3 = Python(IN[0]=python_script_2)  # IronPython2
# ---------- python_script_3.python (52 lines) ----------
import clr
clr.AddReference('RevitServices')
from RevitServices.Persistence import DocumentManager

clr.AddReference("RevitAPI")
from Autodesk.Revit.DB import *

# Função para listar os elementos principais e suas famílias aninhadas
def get_all_elements(element, collected_ids):
    element_list = []
    if isinstance(element, FamilyInstance):
        # Adicionar o elemento principal à lista, se ainda não foi adicionado
        if element.Id not in collected_ids:
            element_list.append(element)
            collected_ids.add(element.Id)
        
        # Verificar se o elemento tem famílias aninhadas
        sub_elements = element.GetSubComponentIds()
        
        # Se o elemento não tiver subcomponentes, garantir que seja adicionado
        if not sub_elements:
            return element_list
        
        # Se tiver subcomponentes, adicionar os aninhados
        for sub_elem_id in sub_elements:
            sub_elem = doc.GetElement(sub_elem_id)
            if isinstance(sub_elem, FamilyInstance) and sub_elem.Id not in collected_ids:
                element_list.append(sub_elem)
                collected_ids.add(sub_elem.Id)
                # Recursivamente buscar subcomponentes dos aninhados
                element_list.extend(get_all_elements(sub_elem, collected_ids))
    
    return element_list

# Coletando o documento ativo
doc = DocumentManager.Instance.CurrentDBDocument

# Entrada 0 - elementos selecionados
input_elements = UnwrapElement(IN[0])

# Inicializando a lista de todos os elementos (principais e aninhados)
all_elements = []

# Inicializando um conjunto para evitar duplicatas com base no ID dos elementos
collected_ids = set()

# Verificando todos os elementos e suas famílias aninhadas
for element in input_elements:
    all_elements.extend(get_all_elements(element, collected_ids))

# Saída - lista de todos os elementos, incluindo principais e aninhados
OUT = all_elements
# ----------------------------------------
TEXTO_3 = Python()  # IronPython2; frozen; unwired: IN[0]; same code as TEXTO_2
preencher_o_parametro_2 = Python(IN[0]=python_script_3, IN[1]=TEXTO_3)  # IronPython2; same code as preencher_o_parametro
python_script_4 = Python()  # IronPython2; frozen; unwired: IN[0]; same code as seleção_dos_elementos
python_script_5 = Python(IN[0]=python_script_4)  # IronPython2
# ---------- python_script_5.python (52 lines) ----------
import clr
clr.AddReference('RevitServices')
from RevitServices.Persistence import DocumentManager

clr.AddReference("RevitAPI")
from Autodesk.Revit.DB import *

# Função para listar os elementos principais e suas famílias aninhadas
def get_all_elements(element, collected_ids):
    element_list = []
    
    # Verificar se o elemento é uma instância de família ou um elemento de sistema (como Pipe)
    if isinstance(element, (FamilyInstance, Pipe, Duct, CableTray, Conduit)):
        # Adicionar o elemento principal à lista, se ainda não foi adicionado
        if element.Id not in collected_ids:
            element_list.append(element)
            collected_ids.add(element.Id)
        
        # Verificar se o elemento tem famílias aninhadas (se aplicável)
        if isinstance(element, FamilyInstance):
            sub_elements = element.GetSubComponentIds()
            if not sub_elements:
                return element_list
            
            # Se o elemento tiver subcomponentes, adicionar os aninhados
            for sub_elem_id in sub_elements:
                sub_elem = doc.GetElement(sub_elem_id)
                if isinstance(sub_elem, FamilyInstance) and sub_elem.Id not in collected_ids:
                    element_list.append(sub_elem)
                    collected_ids.add(sub_elem.Id)
                    # Recursivamente buscar subcomponentes dos aninhados
                    element_list.extend(get_all_elements(sub_elem, collected_ids))
    return element_list

# Coletando o documento ativo
doc = DocumentManager.Instance.CurrentDBDocument

# Entrada 0 - elementos selecionados
input_elements = UnwrapElement(IN[0])

# Inicializando a lista de todos os elementos (principais e aninhados)
all_elements = []

# Inicializando um conjunto para evitar duplicatas com base no ID dos elementos
collected_ids = set()

# Verificando todos os elementos e suas famílias aninhadas
for element in input_elements:
    all_elements.extend(get_all_elements(element, collected_ids))

# Saída - lista de todos os elementos, incluindo principais e aninhados
OUT = all_elements
# ----------------------------------------
TEXTO_4 = Python()  # IronPython2; frozen; unwired: IN[0]; same code as TEXTO_2
preencher_o_parametro_3 = Python(IN[0]=python_script_5, IN[1]=TEXTO_4)  # IronPython2; same code as preencher_o_parametro
python_script_6 = Python()  # IronPython2; frozen; unwired: IN[0]; same code as seleção_dos_elementos
python_script_7 = Python(IN[0]=python_script_6)  # IronPython2
# ---------- python_script_7.python (54 lines) ----------
import clr
clr.AddReference('RevitServices')
from RevitServices.Persistence import DocumentManager

clr.AddReference("RevitAPI")
from Autodesk.Revit.DB import *

# Função para listar os elementos principais e suas famílias aninhadas
def get_all_elements(element, collected_ids):
    element_list = []
    
    # Verificar se o elemento é uma instância de família ou um elemento de sistema (como Pipe)
    if isinstance(element, Element):  # Usando Element como verificação genérica
        # Adicionar o elemento principal à lista, se ainda não foi adicionado
        if element.Id not in collected_ids:
            element_list.append(element)
            collected_ids.add(element.Id)
        
        # Se o elemento for uma FamilyInstance, verificar subcomponentes
        if isinstance(element, FamilyInstance):
            sub_elements = element.GetSubComponentIds()
            if not sub_elements:
                return element_list
            
            # Se o elemento tiver subcomponentes, adicionar os aninhados
            for sub_elem_id in sub_elements:
                sub_elem = doc.GetElement(sub_elem_id)
                if isinstance(sub_elem, FamilyInstance) and sub_elem.Id not in collected_ids:
                    element_list.append(sub_elem)
                    collected_ids.add(sub_elem.Id)
                    # Recursivamente buscar subcomponentes dos aninhados
                    element_list.extend(get_all_elements(sub_elem, collected_ids))
    
    return element_list

# Coletando o documento ativo
doc = DocumentManager.Instance.CurrentDBDocument

# Entrada 0 - elementos selecionados
input_elements = UnwrapElement(IN[0])

# Inicializando a lista de todos os elementos (principais e aninhados)
all_elements = []

# Inicializando um conjunto para evitar duplicatas com base no ID dos elementos
collected_ids = set()

# Verificando todos os elementos e suas famílias aninhadas
for element in input_elements:
    if isinstance(element, Element):  # Verificação genérica de que o objeto é um elemento do Revit
        all_elements.extend(get_all_elements(element, collected_ids))

# Saída - lista de todos os elementos, incluindo principais e aninhados
OUT = all_elements
# ----------------------------------------
TEXTO_5 = Python()  # IronPython2; frozen; unwired: IN[0]; same code as TEXTO_2
preencher_o_parametro_4 = Python(IN[0]=python_script_7, IN[1]=TEXTO_5)  # IronPython2; same code as preencher_o_parametro
python_script_8 = Python()  # IronPython2; unwired: IN[0]; same code as seleção_dos_elementos
python_script_9 = Python(IN[0]=python_script_8)  # IronPython2; same code as python_script_7
TEXTO_6 = Python()  # IronPython2; unwired: IN[0]
# ---------- TEXTO_6.python (98 lines) ----------
import clr
clr.AddReference('System.Windows.Forms')
clr.AddReference('System.Drawing')

from System.Windows.Forms import Application, Form, Label, TextBox, Button, FormStartPosition
from System.Drawing import Point, Size, Color

class MyForm(Form):
    def __init__(self, theme='Dark'):
        # Configurações do Formulário
        self.Text = "Parâmetro ORÇAMENTO TIPO DE SISTEMA"
        self.Size = Size(300, 260)
        self.StartPosition = FormStartPosition.CenterScreen
        self.ShowIcon = False
        self.MaximizeBox = False
        self.MinimizeBox = False

        # Configuração do tema
        if theme == 'Light':
            self.BackColor = Color.White
            self.ForeColor = Color.Black
        else:
            self.BackColor = Color.FromArgb(45, 45, 48)  # Dark theme
            self.ForeColor = Color.White

        self.error_label = None  # Inicializando a variável para o erro
        self.create_form()
        self.create_ok_button()

    def create_form(self):
        """Cria a Label com as opções e o campo de entrada de texto."""
        lbl_options = Label()
        lbl_options.Text = (
            "\nEscolha uma opção:\n\n"
            "1 - AGUA FRIA\n2 - AGUA QUENTE\n3 - DRENAGEM\n4 - ESGOTO SANITARIO"
        )
        lbl_options.Location = Point(20, 20)
        lbl_options.Size = Size(300, 220)
        lbl_options.AutoSize = True
        self.Controls.Add(lbl_options)

        self.txt_input = TextBox()
        self.txt_input.Location = Point(20, 130)
        self.txt_input.Size = Size(240, 30)
        self.Controls.Add(self.txt_input)

    def create_ok_button(self):
        """Cria o botão OK para capturar o texto e fechar o formulário."""
        btn_ok = Button()
        btn_ok.Text = "OK"
        btn_ok.Location = Point((self.ClientSize.Width - 100) // 2, 160)
        btn_ok.Size = Size(100, 30)
        btn_ok.Click += self.on_ok
        self.Controls.Add(btn_ok)

    def on_ok(self, sender, event):
        """Captura o texto digitado e fecha o formulário."""
        options = {
            1: "AGUA FRIA",
            2: "AGUA QUENTE",
            3: "DRENAGEM",
            4: "ESGOTO SANITARIO"
        }

        try:
            # Remove a mensagem de erro anterior, se existir
            if self.error_label:
                self.Controls.Remove(self.error_label)

            input_value = int(self.txt_input.Text)
            if input_value in options:
                self.user_input = options[input_value]
            else:
                self.user_input = None
                self.show_error("Por favor, escolha uma opção válida (1-4).")
        except ValueError:
            self.user_input = None
            self.show_error("Por favor, insira um número válido.")

        if self.user_input is not None:
            self.Close()

    def show_error(self, message):
        """Exibe uma mensagem de erro."""
        self.error_label = Label()
        self.error_label.Text = message
        self.error_label.Location = Point(20, 200)
        self.error_label.Size = Size(300, 30)
        self.error_label.ForeColor = Color.Red
        self.Controls.Add(self.error_label)

# Criação do formulário
theme = "Dark"  # Você pode mudar para "Light" se quiser o tema claro
form = MyForm(theme)
Application.Run(form)

# O texto correspondente à opção escolhida será armazenado na variável 'form.user_input'
OUT = form.user_input
# ----------------------------------------
preencher_o_parametro_5 = Python(IN[0]=python_script_9, IN[1]=TEXTO_6)  # IronPython2; same code as preencher_o_parametro
